# Grasshopper definition Test-Convert-Material.gh (Grasshopper 1.0.7)
# plug-ins: Karamba3D, BH.UI.Grasshopper

matselect = MaterialSelectionKaramba3D(menu=[dropdown(1), dropdown(2)])
karamba3dadapter = Karamba3DAdapter(Component="{ ..ctor")
push = Push(
    Adapter=karamba3dadapter,
    Objects=flatten(matselect),
    PushType="{ \"_t\" : \"System.Enum\", \"TypeName\" : { \"_t\" : \"System.Type\", \"Name\" : \"BH.oM.Adapter.PushType\", \"_bhomVersion\" : \"5.2\" }, \"Value\" : \"AdapterDefault\", \"_bhomVersion\" : \"5.2\" }",
    Active=Toggle(True),
    Component="{ .Push")  # -> Objects, Success
panel = Panel(push.Objects)
explode = Explode(Object=push.Objects, Component="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")  # -> Name, Density, DampingRatio, PoissonsRatio, ThermalExpansionCoeff, YoungsModulus, YieldStress, UltimateStress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
